# Dynamo graph RPW_GettingStarted.dyn (Dynamo 1.2.1.3083)

# note: Revit Python Wrapper
# For more information please see the official documentation: http://revitpythonwrapper.readthedocs.io/
# Github:
# https://github.com/gtalarico/revitpythonwrapper
# License:
# MIT
# Author:
# Gui Talarico
RPW_GetFilepath = Custom[RPW_GetFilepath]()

# group: Collector
python_script = Python(IN[0]=RPW_GetFilepath)
# ---------- python_script.python (14 lines) ----------
""" 
RevitPythonWrapper
==================
Gui Talarico
https://github.com/gtalarico/revitpythonwrapper
http://revitpythonwrapper.readthedocs.io/en/latest/index.html
"""

import sys
sys.path.append(IN[0])

import rpw
col = rpw.db.Collector(of_category='OST_Levels', is_not_type=True)
OUT = col.elements
# ----------------------------------------
get_levels = Watch(python_script)

# group: Get BuiltInParameter
python_script_2 = Python(IN[0]=RPW_GetFilepath)
# ---------- python_script_2.python (17 lines) ----------
""" 
RevitPythonWrapper
==================
Gui Talarico
https://github.com/gtalarico/revitpythonwrapper
http://revitpythonwrapper.readthedocs.io/en/latest/index.html
"""

import sys
sys.path.append(IN[0])

from rpw.db import Element
from rpw.db import Collector
level = Collector(of_category='OST_Levels', is_not_type=True).first
level = Element(level)
param = level.parameters.builtins['DATUM_TEXT']
OUT = param.value
# ----------------------------------------
get_level_name = Watch(python_script_2)

# group: Transaction: Adjust Level Height
number_slider = DoubleSlider(0, range=0..100 step 0.1)
transaction = Python(IN[0]=RPW_GetFilepath, IN[1]=number_slider)
# ---------- transaction.python (10 lines) ----------
import sys
sys.path.append(IN[0])

import rpw

# Collect Levels
level = rpw.db.Collector(of_category='OST_Levels', is_not_type=True).first

with rpw.db.Transaction('Add Comment'):
	level.Elevation = IN[1]
# ----------------------------------------

# group: Revit Version
python_script_3 = Python(IN[0]=RPW_GetFilepath)
# ---------- python_script_3.python (14 lines) ----------
""" 
RevitPythonWrapper
==================
Gui Talarico
https://github.com/gtalarico/revitpythonwrapper
http://revitpythonwrapper.readthedocs.io/en/latest/index.html
"""

import sys
sys.path.append(IN[0])

from rpw import revit

OUT = [revit.version, revit.host]
# ----------------------------------------
revit_version = Watch(python_script_3)

# group: Document
python_script_4 = Python(IN[0]=RPW_GetFilepath)
# ---------- python_script_4.python (14 lines) ----------
""" 
RevitPythonWrapper
==================
Gui Talarico
https://github.com/gtalarico/revitpythonwrapper
http://revitpythonwrapper.readthedocs.io/en/latest/index.html
"""

import sys
sys.path.append(IN[0])

from rpw import doc

OUT = doc
# ----------------------------------------
revit_version_2 = Watch(python_script_4)

# group: User Input: SelectFromList
boolean = BoolSelector(false)
python_script_5 = Python(IN[0]=RPW_GetFilepath, IN[1]=boolean)
# ---------- python_script_5.python (17 lines) ----------
""" 
RevitPythonWrapper
==================
Gui Talarico
https://github.com/gtalarico/revitpythonwrapper
http://revitpythonwrapper.readthedocs.io/en/latest/index.html
"""

import sys
sys.path.append(IN[0])

from rpw.ui import forms

if IN[1]:
	options = ['A', 'B', 'C']
	selected = forms.SelectFromList('Title', options)
	OUT = selected
# ----------------------------------------
result = Watch(python_script_5)

# group: User Input: Text Input
boolean_2 = BoolSelector(false)
python_script_6 = Python(IN[0]=RPW_GetFilepath, IN[1]=boolean_2)
# ---------- python_script_6.python (16 lines) ----------
""" 
RevitPythonWrapper
==================
Gui Talarico
https://github.com/gtalarico/revitpythonwrapper
http://revitpythonwrapper.readthedocs.io/en/latest/index.html
"""

import sys
sys.path.append(IN[0])

from rpw.ui import forms

if IN[1]:
	value = forms.TextInput('Title', default="Type something")
	OUT = value
# ----------------------------------------
result_2 = Watch(python_script_6)

watch = Watch(RPW_GetFilepath)
