# Dynamo graph dynamo_test_runner.dyn (Dynamo 1.2.1.3083)

local_development_path = Directory("C:\Users\gtalarico\Dropbox\Shared\dev\repos\revitpythonwrapper\revitpythonwrapper.lib\tests\rpw.extension\rpw.tab\rpw.panel")

# group: Python Tests
file_path = Filename(".\dynamo_test_runner.py")
readText = File.ReadText(file_path)
python_script_from_string = PythonStringNode(script=readText, IN[0]=local_development_path)
watch = Watch(python_script_from_string)
